# Grasshopper definition World.gh (Grasshopper 0.9.76)
# plug-ins: Python Interpreter

number_of_divs = Slider(8, range=0..10)
file = ReadFile(File="E:\Desk\822 犀牛学习\algo\gh_snippets\ArchiCellAutomata\world.py", PerLineParse=False)
python = PythonScript(Code=file, Input_size=number_of_divs)  # -> Out, A, B
panel = Panel(python.Out)
panel_2 = Panel(python.B)
not = GateNot(A=python.A)
panel_3 = Panel(python.A)
not_2 = GateNot(A=not)
pt = Point(python.B)
panel_4 = Panel(not_2)
number_slider = Slider(1500, range=0..10000)
cull = CullPattern(List=pt, CullPattern=not_2)
panel_5 = Panel(cull)
pl = ConstructPlane(Origin=cull, XAxis=Vector(1, 0, 0), YAxis=Vector(0, 1, 0))
dom = ConstructDomain(DomainStart=expr("-x", number_slider), DomainEnd=number_slider)
rectangle = Rectangle(Plane=pl, XSize=dom, YSize=dom, Radius=0)  # -> Rectangle, Length
box = DomainBox(Base=pl, X=dom, Y=dom, Z=dom)
